# Grasshopper definition opossum_example.gh (Grasshopper 1.0.7)
# plug-ins: Opossum2_0_Proto_A

v1 = Slider(-5, range=-5..10)
# Single-objective optimization
# (RBFOpt, CMA-ES)
# Opossum offers two of the best performing, single-objective algorithms in Grasshopper: RBFOpt and CMA-ES.
# Opossum also offers the multi-objective algorithms RBFMOpt and NSGA-II.
# 
# 
# Opossum will offer either RBFOpt and CMA-ES or RBFMOpt and NSGA-II, depending on how many objectives are connected.
# 
# RBFOpt should find the optimal value of the Branin test function (0.398) within 50 evaluations, or at least come very close to it.
# CMA-ES should take around 300 evaluations.
# 
# To find this optimum, Opossum manipulates the number sliders (or genepools), which represents the function's variables.
# 
# The objective is the result of the function.
# Make sure that your definition always produces a single value per objective!
# 
# 
# RBFOpt's strength is finding close to optimal solutions in 100-300 evaluations (i.e., simulations).
# This high speed of convergence is especially useful for simulations that take a long time.
# 
# CMA-ES reliably finds near-optimal solutions when you can afford not hundreds, but thousands of steps.
# A rule of thumb is to perform number of variables ((i.e., number of sliders)) + 1 * 100 evaluations.
# 
# CMA-ES can benefit from a good starting point:
# Use RBFOpt to find a good starting point, and to improve this point with CMA-ES.
# (If you don’t want to use a starting point, choose “CMA-ES with random start.”
# 
# 
# Multi-objective optimization is much more difficult than single-objective.
# Try to keep the number of objectives small, ideally to one.
# 
# NSGA-II is a “standard” multi-objective algorithm.
# RBFMOpt is a multi-objective version of RBFOpt that, according to early tests, is much more efficient than NSGA-II.
# 
# 
# The Results tab lets you examine the solutions evaluated during the optimization process by double-clicking on the entries in the table.
# 
# Have fun optimizing, and let us know how it goes!
v2 = Slider(0, range=0..15)
eval_branin = Evaluate(F="(y - (5.1 / (4 * π * π)) * x * x + 5 / π * x - 6)² + 10 * (1 - 1 / (8 * π)) * cos(x) + 10", x=v1, y=v2)
panel = Panel(eval_branin)
surrogate_model_based_optimization = SuMO(
    OpossumData_NumberOfObjectives=0,
    OpossumData_OptimizationType=0,
    OpossumData_ResultSerializationStatus=0,
    OpossumData_objective=eval_branin,
    OpossumData_variable=[v1, v2])
# Multi-objective optimization
# (RBFMOpt, NSGA-II)
genes = GenePool(Decimals=3, Maximum=1, Minimum=0, Value=[0, 0, 0, 0, 0])
eval_dtlz4 = CSharpScript(x=genes, m=2)  # -> out, fx; inputs x: list of Double, m: Int32
# ---------- eval_dtlz4: C# ----------
    var x_array = x.ToArray();
    fx = MOM_DTLZ4(x_array, m);
# ---------- eval_dtlz4: C# additional code ----------
  /// <summary>
  /// DEB-THIELE-LAUMANNS-ZITZLER N.4 Function.
  /// <para/> Objectives: M ϵ [2,10].
  /// <para/> Real variables: ∞. k = 10 suggested. (k = n - M + 1), where n is number of variables.
  /// <para/> Binary variables: 0.
  /// <para/> Constraints: 0.
  /// <para/> Source: Deb, Thiele, Laumanns, Zitzler (2001). Scalable Test Problems for Evolutionary Multi-Objective Optimization.
  /// </summary>
  /// <param name="x">Decision variable vector. xi, i = 1, ..., n.</param>
  /// <param name="M">Number of Objectives. M ϵ [2,10].</param>
  /// <returns>Objective function values f(x).</returns>
  public static double[] MOM_DTLZ4(double[] x, int M, double alpha = 100)
  {
    int i = 0, j = 0;
    int n = x.Length;
    int k = n - M + 1;

    double g = 0;
    for (i = n - k + 1; i <= n; i++)
    {
      g += Math.Pow(x[i - 1] - 0.5, 2);
    }

    double[] fx = new double[M];
    for (i = 1; i <= M; i++)
    {
      double f = (1 + g);
      for (j = M - i; j >= 1; j--)
      {
        f *= Math.Cos(Math.Pow(x[j - 1], alpha) * Math.PI / 2);
      }
      if (i > 1)
      {
        f *= Math.Sin(Math.Pow(x[(M - i + 1) - 1], alpha) * Math.PI / 2);
      }

      fx[i - 1] = f;
    }

    return fx;
  }
# ---------- end eval_dtlz4 ----------
item = ListItem(List=eval_dtlz4.fx, Index=0, Wrap=True)
item_2 = ListItem(List=eval_dtlz4.fx, Index=1, Wrap=True)
optimization_solver_with_surrogate_model = Opossum20(
    OpossumData_NumberOfObjectives=2,
    OpossumData_OptimizationType=0,
    OpossumData_ResultSerializationStatus=0,
    OpossumData_ObjectiveList=[[1.148426, 2.49e-196], [0.542501721, 1.25626846], [1.526071, 1.52e-34], [1, 1.24e-30], [0.5578336487, 1.90406578], [1.96661, 8.21e-205]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],
    OpossumData_ParameterList=["0,0.011161,0.363841,0.140581,0.494671,0.468043", "16,0.996795,0.156463,0.544384,0.932258,0.747605", "23.448771,0.455256,0.91704,0.846946,0.11829,0.207212", "25.433774,0.5,0.5,0.5,0.5,0.5", "25.620237,0.998119,0.992393,0.003078,0.005054,0.999666", "28.84858,0.008612,0.987091,0.978663,0.999551,0.999993"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],
    OpossumData_objective=[item, item_2],
    OpossumData_variable=genes)  # "Optimization Solver with Surrogate Models"
